# Grasshopper definition Final 1.gh (Grasshopper 0.9.76)
# plug-ins: Firefly.X, Kangaroo Components, Firefly.Core

ports_available = COMPortsAvailable()
motors = Integer(6)

# ----
# Add rotation from accelerometer
# 
# COM6 Handles motor commands and limit switches
# COM9 Handles (wireless) accelerometer and servo
# r = 32mm
# C = piD
# C = 200mm
# 
# So one step is one mm
ports_available_2 = COMPortsAvailable()
panel = Panel(ports_available_2)
servo_dn = Slider(85, range=0..100)
servo_up = Slider(94, range=0..100)
panel_2 = Panel("100")
z_axis = Integer(7)
open_port = OpenClosePort(OpenClosePort=Toggle(True), PortNumber=motors, BaudRate=115200)
open_port_2 = OpenClosePort(OpenClosePort=Toggle(True), PortNumber=z_axis, BaudRate=115200)
merge = Merge(Data1=servo_up, Data2=servo_dn)
panel_3 = Panel(open_port)
item = ListItem(List=merge, Index=Toggle(False), Wrap=True)
int = Integer(item)
write = SerialWriteGeneric(StartWritingValues=Toggle(True), WriteData=int, PortNumber=z_axis)  # -> ArduinoOutput, StatusMessage
panel_4 = Panel(write.StatusMessage)
timer = Timer(TimerInterval=20, Target=[osc_listener, write])

pt = Point(<point referenced from the Rhino model>)
xz = XZPlane(Origin=Point(0, 0, 0))
crv = Curve(<curve referenced from the Rhino model>)
offset = Offset(Curve=crv, Distance=Slider(-60, range=-1000..1000), Plane=xz, Corners=1)
explode = Explode(Curve=offset, Recursive=True)  # -> Segments, Vertices
item_2 = ListItem(List=explode.Vertices, Index=3, Wrap=True)
item_3 = ListItem(List=explode.Vertices, Index=0, Wrap=True)
item_4 = ListItem(List=explode.Vertices, Index=2, Wrap=True)
item_5 = ListItem(List=explode.Vertices, Index=1, Wrap=True)

timer_2 = Timer(TimerInterval=20, Target=counter)  # disabled
crv_2 = Curve([<curve referenced from the Rhino model> x97])
explode_2 = Explode(Curve=crv_2, Recursive=True)  # -> Segments, flatten(Vertices)
counter = Counter(Reset=Toggle(False))
divlength = DivideLength(Curve=crv_2, Length=2)  # -> flatten(Points), Tangents, Parameters
item_6 = ListItem(List=divlength.Points, Index=counter, Wrap=True)
dist = Distance(PointA=item_5, PointB=item_6)
dist_2 = Distance(PointA=item_4, PointB=item_6)
ln = Line(StartPoint=item_6, EndPoint=item_5)
ln_2 = Line(StartPoint=item_6, EndPoint=item_4)
dist_3 = Distance(PointA=pt, PointB=item_4)
dist_4 = Distance(PointA=pt, PointB=item_5)
subtraction = Subtraction(A=dist_3, B=dist_2)
subtraction_2 = Subtraction(A=dist_4, B=dist)
multiplication = Multiplication(A=subtraction_2, B=-8)
multiplication_2 = Multiplication(A=subtraction, B=8)
int_2 = Integer(multiplication)
int_3 = Integer(multiplication_2)
steps = Panel(int_3)
steps_2 = Panel(int_2)

max_speed = Slider(14990, range=1000..32000)
accel = Slider(6400, range=100..32000)
int_4 = Integer(motors)
stepper_motor = QuadStepperMotorStream(
    Start=Toggle(True),
    Reset=Toggle(False),
    MaxSpeed=max_speed,
    Acceleration=accel,
    Motor1Steps=steps,
    Motor2Steps=steps_2,
    Motor3Steps=0,
    Motor4Steps=0,
    Port=int_4)  # -> FormattedString, StatusMessage
formatted_string = Panel(stepper_motor.FormattedString)
msg = Panel(stepper_motor.StatusMessage)
log = DataLog(ResetLog=False, StartRecording=True, WrapValues=False, RecordingLength=0)

reset = BooleanToggle(False)
osc_listener = OSCListener(Port="8000", Reset=reset)
panel_5 = Panel(osc_listener)
item_7 = ListItem(List=osc_listener, Index="1", Wrap=True)
md_slider = MDSlider(
    slider_value=Point(0.453165727, 0.8140243902, 0.5),
    SliderMode=0,
    x_domain=Domain(0, 1),
    y_domain=Domain(0, 1),
    z_domain=Domain(0, 1))
pdecon = Deconstruct(Point=md_slider)  # -> XComponent, YComponent, ZComponent
pt_2 = ConstructPoint(XCoordinate=pdecon.YComponent, YCoordinate=pdecon.XComponent, ZCoordinate=0)
merge_2 = Merge(Data1=pt_2, Data2=item_7)
item_8 = ListItem(List=merge_2, Index=Toggle(False), Wrap=True)
pcomp = Decompose(Point=item_8)  # -> XComponent, YComponent, ZComponent
buffer = Buffer(Number=pcomp.XComponent, BufferDomain=Domain(0, 2))  # -> BufferValues, BufferMinimum, BufferMaximum
buffer_2 = Buffer(Number=pcomp.YComponent, BufferDomain=Domain(0, 2))  # -> BufferValues, BufferMinimum, BufferMaximum
subtraction_3 = Subtraction(A=pcomp.XComponent, B=buffer.BufferValues)
subtraction_4 = Subtraction(A=pcomp.YComponent, B=buffer_2.BufferValues)
item_9 = ListItem(List=subtraction_3, Index=1, Wrap=True)
item_10 = ListItem(List=subtraction_4, Index=1, Wrap=True)
addition = Addition(A=item_9, B=item_10)
abs = Absolute(Value=addition)

item_11 = ListItem(List=explode.Vertices, Index=1, Wrap=True)
dim = Dimensions(Surface=offset)  # -> UDimension, VDimension
pdecon_2 = Deconstruct(Point=item_11)  # -> XComponent, YComponent, ZComponent
multiplication_3 = Multiplication(A=pcomp.YComponent, B=dim.UDimension)
multiplication_4 = Multiplication(A=pcomp.XComponent, B=dim.VDimension)
addition_2 = Addition(A=multiplication_3, B=pdecon_2.XComponent)
addition_3 = Addition(A=multiplication_4, B=pdecon_2.ZComponent)
pt_3 = ConstructPoint(XCoordinate=addition_2, YCoordinate=0, ZCoordinate=addition_3)
ln_3 = Line(StartPoint=pt_3, EndPoint=item_5)
ln_4 = Line(StartPoint=pt_3, EndPoint=item_3)
ln_5 = Line(StartPoint=pt_3, EndPoint=item_4)
ln_6 = Line(StartPoint=pt_3, EndPoint=item_2)
dist_5 = Distance(PointA=item_5, PointB=pt_3)
dist_6 = Distance(PointA=item_4, PointB=pt_3)
dist_7 = Distance(PointA=pt, PointB=item_4)
dist_8 = Distance(PointA=pt, PointB=item_5)
subtraction_5 = Subtraction(A=dist_7, B=dist_6)
subtraction_6 = Subtraction(A=dist_8, B=dist_5)
multiplication_5 = Multiplication(A=subtraction_6, B=-8)
multiplication_6 = Multiplication(A=subtraction_5, B=8)
int_5 = Integer(multiplication_5)
int_6 = Integer(multiplication_6)
steps_3 = Panel(int_6)
steps_4 = Panel(int_5)

penup = CSharpScript(x=abs, y=pt_3)  # -> out, A, B; inputs x: Double, y: Point3d
# ---------- penup: C# ----------
    Point3d p = new Point3d();

    if(x > 0.001 && x < 0.08){
      p = y;
      Plane pp = new Plane(p, Vector3d.YAxis);
      Circle c = new Circle(pp, 100);
      A = c;
      B = true;
    }
    else{
      B = false;
    }
# ---------- end penup ----------
panel_6 = Panel(penup.B)
